% Requirement links of sm_aileron_actuator_pct_temp.slx (R2018a)

block :1142 links to Aileron_Actuator_Requirements.docx#@Simulink_requirement_item_1: Actuator System Requirements
block :1956 links to Aileron_Actuator_Requirements.docx#@Simulink_requirement_item_2: Aero Load Requirements