% Requirement links of sm_aileron_actuator_protected.slx (R2019b)

block :1142 implements Aileron_Actuator_Requirements.docx#@Simulink_requirement_item_1: Actuator System Requirements
block :1956 implements Aileron_Actuator_Requirements.docx#@Simulink_requirement_item_2: Aero Load Requirements